% Simulink data dictionary DHM.sldd

Gear_Posn_E = enum(DefaultValue="Gear_Reserved1", StorageType="uint8")
  Gear_Reserved1 = 0
  Gear_P = 1
  Gear_R = 2
  Gear_N = 3
  Gear_D = 4
  Gear_Reserved2 = 5

Learn_Sts_E = enum(DefaultValue="Learn_Invalid", StorageType="uint8")
  Learn_Invalid = 0
  Learn_Success = 1
  Learn_Fail = 2
  Learn_Reserved = 3

HndPos_Sts_E = enum(DefaultValue="Hnd_Fold", StorageType="uint8")
  Hnd_Fold = 0
  Hnd_Unfold = 1
  Hnd_Unknown = 2
  Hnd_Reserved = 3

Door_Sts_E = enum(DefaultValue="Door_Lock", StorageType="uint8")
  Door_Lock = 0
  Door_Unlock = 1
  Door_Superlock = 2
  Door_Unknown = 3